# Grasshopper definition wallacei_test_complete.gh (Grasshopper 1.0.7)
# plug-ins: Wallacei

wlc_position = GenePool(
    Decimals=2,
    Maximum=1000,
    Minimum=-1000,
    Value=[880.83, 710.86, 172.85, -919.28, -571.53, -883.33, 81.74, 640.35, 308.53, -21.01, 188.61, 134.5, 735.13, 251.17, 171.15])

curve = Curve([<curve referenced from the Rhino model> x3])
divide_curve = DivideCurve(Curve=curve, Count=Slider(4, range=0..10), Kinks=False)  # -> simplify(Points), Tangents, Parameters
unit_z = UnitZ(Factor=wlc_position)
unflatten_tree = UnflattenTree(Tree=unit_z, Guide=divide_curve.Points)
move = Move(Geometry=divide_curve.Points, Motion=unflatten_tree)  # -> Geometry, Transform
nurbs_curve = NurbsCurve(Vertices=move.Geometry, Degree=3, Periodic=False)  # -> Curve, Length, Domain
flatten_tree = FlattenTree(Tree=nurbs_curve.Curve, Path="{0}")
loft = Loft(Curves=flatten_tree, Options={Adjust=False, Closed=False, LoftEnds=0, LoftSimp=0, LoftType=0, Rebuild=10, Refit=0.01})
divide_surface = DivideSurface(Surface=loft, UCount=10, VCount=10)  # -> Points, Normals, Parameters
loft_2 = Loft(Curves=curve, Options={Adjust=False, Closed=False, LoftEnds=0, LoftSimp=0, LoftType=0, Rebuild=10, Refit=0.01})
polyline = PolyLine(Vertices=divide_surface.Points, Closed=False)  # -> flatten(Polyline)
loft_3 = Loft(Curves=polyline, Options={Adjust=False, Closed=False, LoftEnds=0, LoftSimp=0, LoftType=3, Rebuild=10, Refit=0.01})
md_slider = MDSlider(SliderMode=0, slider_value=Point(0.5, 0.5, 0.5), x_domain=Domain(0, 1), y_domain=Domain(0, 1), z_domain=Domain(0, 1))
deconstruct_brep = DeconstructBrep(Brep=loft_3)  # -> Faces, Edges, Vertices
divide_surface_2 = DivideSurface(Surface=loft_2, UCount=10, VCount=10)  # -> Points, Normals, Parameters
area = Area(Geometry=loft)  # -> Area, Centroid
area_2 = Area(Geometry=loft_2)  # -> Area, Centroid
surface_curvature = SurfaceCurvature(Surface=reparameterize(deconstruct_brep.Faces), Point=md_slider)  # -> Frame, Gaussian, Mean
distance = Distance(PointA=divide_surface.Points, PointB=divide_surface_2.Points)
subtraction = Subtraction(A=area.Area, B=area_2.Area)
number_slider = Slider(100000000, range=0..100000000)
absolute = Absolute(Value=surface_curvature.Gaussian)
absolute_2 = Absolute(Value=subtraction)
flatten_tree_2 = FlattenTree(Tree=distance, Path="{0}")
multiplication = Multiplication(A=absolute, B=number_slider)
average = Average(Input=flatten_tree_2)
sort_list = SortList(Keys=multiplication)  # -> Keys, ValuesValuesA
wlc_minimize_area_difference = Number(flatten(absolute_2))
wlc_minimize_distance = Number(flatten(average))
reverse_list = ReverseList(List=sort_list.Keys)
division = Division(A=absolute_2, B=Slider(1000000, range=0..1000000))
list_item = ListItem(List=reverse_list, Index=0, Wrap=True)
wlc_minimize_curvature = Number(flatten(list_item))
geometry = Geometry(loft_3)
entwine = Entwine(Branch00=geometry, Branch01=list_item, Branch02=division, FlattenInputs=True)  # -> simplify(Result)
wallacei_x = WallaceiX(
    Genes=wlc_position,
    Objectives=[wlc_minimize_curvature, wlc_minimize_area_difference, wlc_minimize_distance],
    Phenotype=entwine,
    allFitness="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",
    allFrontIdx="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",
    allGenomes="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",
    curFrontIdx="99|0;99|1;99|2;99|3;99|4;99|5;99|6;99|7;99|8;99|9;99|10;99|11;99|12;99|13;99|14;99|15;99|16;99|17;99|18;99|19;99|20;99|21;99|22;99|23;99|24;99|25;99|26;99|27;99|28;99|29;99|30;99|31;99|32;99|33;99|34;99|35;99|36;99|37;99|38;99|39;99|40;99|41;99|42;99|43;99|44;99|45;99|46;99|47;99|48;99|49",
    curFrontIdxSave="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",
    popGen="50,100",
    total="200218",
    wlcDone=True)  # -> WallaceiGenomes, FitnessValues, Data, Phenotypes

divide_surface_3 = DivideSurface(Surface=loft_2, UCount=10, VCount=10)  # -> Points, Normals, Parameters
polyline_2 = PolyLine(Vertices=divide_surface_3.Points, Closed=False)  # -> flatten(Polyline)
loft_4 = Loft(Curves=polyline_2, Options={Adjust=False, Closed=False, LoftEnds=0, LoftSimp=0, LoftType=3, Rebuild=10, Refit=0.01})
deconstruct_brep_2 = DeconstructBrep(Brep=loft_4)  # -> Faces, Edges, Vertices
surface_curvature_2 = SurfaceCurvature(Surface=reparameterize(deconstruct_brep_2.Faces), Point=md_slider)  # -> Frame, Gaussian, Mean
absolute_3 = Absolute(Value=surface_curvature_2.Gaussian)
multiplication_2 = Multiplication(A=absolute_3, B=Slider(100000000, range=0..100000000))
bounds = Bounds(Numbers=multiplication_2)
remap_numbers = RemapNumbers(Value=multiplication_2, Source=bounds, Target=Domain(0, 1))  # -> Mapped, Clipped
gradient = Gradient(
    LowerLimit=0,
    UpperLimit=1,
    Parameter=remap_numbers.Mapped,
    stops=[0: RGB(0, 153, 255), 0.306: RGB(0, 128, 0), 0.644: RGB(255, 255, 0), 1: RGB(255, 0, 0)])
custom_preview = CustomPreview(Geometry=deconstruct_brep_2.Faces, Material=gradient)

decode_phenotype = DecodePhenotype(WallaceiPhenotype=wallacei_x.Phenotypes)  # -> GeometriesList, MeshesList, NumbersList, TextList
shift_paths = ShiftPaths(Data=decode_phenotype.GeometriesList, Offset=-1)
tree_statistics = TreeStatistics(Tree=shift_paths)  # -> Paths, Length, Count
tree_branch = TreeBranch(Tree=wallacei_x.FitnessValues, Path=tree_statistics.Paths, MaintainPaths=True)
distribute_to_grid = DistributeToGrid(FitnessValues=tree_branch, WallaceiPhenotypes=wallacei_x.Phenotypes, OutputOptions=0)  # -> DistributedFitnessValues, DistributedData, DistributedGeometries, DistributedMeshes, DistributedNumbers, GridLocations

shift_paths_2 = ShiftPaths(Data=distribute_to_grid.DistributedNumbers, Offset=-1)
number_slider_2 = Slider(657, range=0..1000)
list_length = ListLength(List=shift_paths_2)
series = Series(Start=number_slider_2, Step=number_slider_2, Count=list_length)
geometry_2 = Geometry(distribute_to_grid.GridLocations)
unit_y = UnitY(Factor=series)
negative = Negative(Value=unit_y)
move_2 = Move(Geometry=geometry_2, Motion=negative)  # -> Geometry, Transform
geometry_3 = Geometry(distribute_to_grid.DistributedGeometries)
text_tag_3d = TextTag3D(Location=move_2.Geometry, Text=shift_paths_2, Size=number_slider_2, Justification=7)

md_slider_2 = MDSlider(SliderMode=0, slider_value=Point(0.5, 0.5, 0.5), x_domain=Domain(0, 1), y_domain=Domain(0, 1), z_domain=Domain(0, 1))
deconstruct_brep_3 = DeconstructBrep(Brep=geometry_3)  # -> Faces, Edges, Vertices
surface_curvature_3 = SurfaceCurvature(Surface=reparameterize(deconstruct_brep_3.Faces), Point=md_slider_2)  # -> Frame, Gaussian, Mean
absolute_4 = Absolute(Value=surface_curvature_3.Gaussian)
multiplication_3 = Multiplication(A=absolute_4, B=number_slider)
remap_numbers_2 = RemapNumbers(Value=multiplication_3, Source=bounds, Target=Domain(0, 1))  # -> Mapped, Clipped
tree_branch_2 = TreeBranch(Tree=wallacei_x.WallaceiGenomes, Path=tree_statistics.Paths, MaintainPaths=True)
gradient_2 = Gradient(
    LowerLimit=0,
    UpperLimit=1,
    Parameter=remap_numbers_2.Mapped,
    stops=[0: RGB(0, 153, 255), 0.308: RGB(0, 128, 0), 0.644: RGB(255, 255, 0), 1: RGB(255, 0, 0)])
decode_genome = DecodeGenome(WallaceiGenome=tree_branch_2)
custom_preview_2 = CustomPreview(Geometry=deconstruct_brep_3.Faces, Material=gradient_2)
