# Grasshopper definition walaceikangaroo.gh (Grasshopper 1.0.7)
# plug-ins: Wallacei

wlc_position = GenePool(
    Decimals=2,
    Maximum=1000,
    Minimum=-1000,
    Value=[168.69, 538.83, 77.27, 582.56, -533.04, -3.71, -628.88, 465.37, 349.78, -131.78, 223.29, 72.28, 690.75, 92.92, -123.33])
curve = Curve([<curve referenced from the Rhino model> x3])
divide_curve = DivideCurve(Curve=curve, Count=Slider(4, range=0..10), Kinks=False)  # -> simplify(Points), Tangents, Parameters
unit_z = UnitZ(Factor=wlc_position)
unflatten_tree = UnflattenTree(Tree=unit_z, Guide=divide_curve.Points)
move = Move(Geometry=divide_curve.Points, Motion=unflatten_tree)  # -> Geometry, Transform
nurbs_curve = NurbsCurve(Vertices=move.Geometry, Degree=3, Periodic=False)  # -> Curve, Length, Domain
flatten_tree = FlattenTree(Tree=nurbs_curve.Curve, Path="{0}")
loft = Loft(Curves=flatten_tree, Options={Adjust=False, Closed=False, LoftEnds=0, LoftSimp=0, LoftType=0, Rebuild=10, Refit=0.01})
divide_surface = DivideSurface(Surface=loft, UCount=10, VCount=10)  # -> Points, Normals, Parameters
polyline = PolyLine(Vertices=divide_surface.Points, Closed=False)  # -> flatten(Polyline)
loft_2 = Loft(Curves=polyline, Options={Adjust=False, Closed=False, LoftEnds=0, LoftSimp=0, LoftType=3, Rebuild=10, Refit=0.01})
loft_3 = Loft(Curves=curve, Options={Adjust=False, Closed=False, LoftEnds=0, LoftSimp=0, LoftType=0, Rebuild=10, Refit=0.01})
md_slider = MDSlider(SliderMode=0, slider_value=Point(0.5, 0.5, 0.5), x_domain=Domain(0, 1), y_domain=Domain(0, 1), z_domain=Domain(0, 1))
deconstruct_brep = DeconstructBrep(Brep=loft_2)  # -> Faces, Edges, Vertices
divide_surface_2 = DivideSurface(Surface=loft_3, UCount=10, VCount=10)  # -> Points, Normals, Parameters
area = Area(Geometry=loft)  # -> Area, Centroid
area_2 = Area(Geometry=loft_3)  # -> Area, Centroid
evaluate_surface = EvaluateSurface(Surface=reparameterize(deconstruct_brep.Faces), Point=md_slider)  # -> Point, Normal, UDirection, VDirection, Frame
surface_curvature = SurfaceCurvature(Surface=reparameterize(deconstruct_brep.Faces), Point=md_slider)  # -> Frame, Gaussian, Mean
distance = Distance(PointA=divide_surface.Points, PointB=divide_surface_2.Points)
subtraction = Subtraction(A=area.Area, B=area_2.Area)
absolute = Absolute(Value=surface_curvature.Gaussian)
absolute_2 = Absolute(Value=subtraction)
flatten_tree_2 = FlattenTree(Tree=distance, Path="{0}")
multiplication = Multiplication(A=absolute, B=Slider(100000000, range=0..100000000))
average = Average(Input=flatten_tree_2)
sort_list = SortList(Keys=multiplication)  # -> Keys, ValuesA
wlc_minimize_area_difference = Number(flatten(absolute_2))
wlc_minimize_distance = Number(flatten(average))
reverse_list = ReverseList(List=sort_list.Keys)
division = Division(A=absolute_2, B=Slider(1000000, range=0..1000000))
list_item = ListItem(List=reverse_list, Index=0, Wrap=True)
entwine = Entwine(Branch00=surface_curvature.Gaussian, Branch01=division, FlattenInputs=True)  # -> simplify(Result)
wlc_minimize_curvature = Number(flatten(list_item))
geometry = Geometry(loft_2)  # disabled
wallacei_x = WallaceiX(
    Genes=wlc_position,
    Objectives=[wlc_minimize_curvature, wlc_minimize_area_difference, wlc_minimize_distance],
    Data=entwine,
    Phenotype=geometry,
    allFitness="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",
    allFrontIdx="9|1;16|13;17|1;17|12;18|15;19|15;21|18;22|18;25|2;25|11;25|14;26|15;27|6;33|16;37|10;38|11;38|18;38|19;39|5;39|18;39|19;40|9;40|14;43|13;43|14;46|15;47|12;49|6;49|14;50|2;50|12;52|14;55|18;56|0;56|1;56|2;58|13;58|16;59|16;61|7;65|8;65|12;66|14;67|15;68|2;68|19;70|3;70|13;71|15;72|19;73|2;73|15;73|16;75|8;76|11;78|9;81|2;81|12;81|16;82|5;83|1;83|6;83|10;83|16;84|8;85|2;85|9;86|2;86|14;86|18;87|6;87|19;88|15;89|2;89|7;89|14;89|18;90|10;90|15;91|12;91|19;92|2;92|9;93|4;94|1;94|17;95|8;95|9;96|19;97|10;97|19",
    allGenomes="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",
    curFrontIdx="99|0;99|1;99|2;99|3;99|4;99|5;99|6;99|7;99|8;99|9;99|10;99|11;99|12;99|13;99|14;99|15;99|16;99|17;99|18;99|19",
    curFrontIdxSave="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",
    popGen="20,100",
    total="63781",
    wlcDone=True)  # -> WallaceiGenomes, FitnessValues, Data, Phenotypes
decode_phenotype = DecodePhenotype(WallaceiPhenotype=wallacei_x.Phenotypes)  # -> GeometriesList, MeshesList, NumbersList, TextList
shift_paths = ShiftPaths(Data=decode_phenotype.MeshesList, Offset=-1)
geometry_2 = Geometry(decode_phenotype.MeshesList)
tree_statistics = TreeStatistics(Tree=shift_paths)  # -> Paths, Length, Count
tree_branch = TreeBranch(Tree=wallacei_x.FitnessValues, Path=tree_statistics.Paths, MaintainPaths=True)
distribute_to_grid = DistributeToGrid(FitnessValues=tree_branch, WallaceiPhenotypes=wallacei_x.Phenotypes, OutputOptions=0)  # -> DistributedFitnessValues, DistributedData, DistributedGeometries, DistributedMeshes, DistributedNumbers, GridLocations

number_slider = Slider(657, range=0..1000)
list_length = ListLength(List=distribute_to_grid.DistributedFitnessValues)
series = Series(Start=number_slider, Step=number_slider, Count=list_length)
geometry_3 = Geometry(distribute_to_grid.GridLocations)
unit_y = UnitY(Factor=series)
negative = Negative(Value=unit_y)
move_2 = Move(Geometry=geometry_3, Motion=negative)  # -> Geometry, Transform
text_tag_3d = TextTag3D(Location=move_2.Geometry, Text=distribute_to_grid.DistributedFitnessValues, Size=number_slider, Justification=7)
geometry_4 = Geometry(distribute_to_grid.DistributedMeshes)

surface_curvature_2 = SurfaceCurvature()  # -> Frame, Gaussian, Mean
